# Grasshopper definition test.gh (Grasshopper 1.0.8)
# plug-ins: RhinoCodePluginGH, treesloth01, Dodo, Labrador, eleFront, Wombat, IPMSpatialAnalysis

mesh = Mesh([<mesh referenced from the Rhino model> x967])
mesh_2 = Mesh([<mesh referenced from the Rhino model> x777])
mesh_3 = Mesh([<mesh referenced from the Rhino model> x416])
mesh_4 = Mesh([<mesh referenced from the Rhino model> x408])
mesh_5 = Mesh([<mesh referenced from the Rhino model> x417])
mesh_6 = Mesh([<mesh referenced from the Rhino model> x817])
entwine = Entwine(Branch00=mesh_3, Branch01=mesh_4, Branch02=mesh_5, Branch03=mesh_6, Branch04=mesh, Branch05=mesh_2, FlattenInputs=True)
entwine_2 = Entwine(Branch00=mesh_6, Branch01=mesh, Branch02=mesh_2, FlattenInputs=True)
settings = CreateSettings(VoxelSize=Slider(0.02, range=0.01..0.5), Adaptivity=Slider(0, range=0..1))
number_slider = Slider(0, range=0..0.5)
mjoin = MeshJoin(Meshes=entwine)
frommesh = CreateFromMesh(Mesh=mjoin, Settings=settings)
neg = Negative(Value=number_slider)
doubleoffset = DoubleOffset(Volume=frommesh, Offset1=number_slider, Offset2=neg, Settings=settings)
number_slider_2 = Slider(0.0081, range=0..0.0081)
volumetomesh = VolumeToMesh(Volume=doubleoffset)
disjoint = DisjointMesh(Mesh=volumetomesh)
volume = Volume(Geometry=disjoint)  # -> Volume, Centroid
smaller = SmallerThan(FirstNumber=volume.Volume, SecondNumber=number_slider_2)  # -> SmallerThan, OrEqualTo
larger = LargerThan(FirstNumber=volume.Volume, SecondNumber=number_slider_2)  # -> LargerThan, OrEqualTo
cull = CullPattern(List=disjoint, CullPattern=smaller.SmallerThan)
cull_2 = CullPattern(List=volume.Volume, CullPattern=smaller.SmallerThan)
bnd = Bounds(Numbers=flatten(volume.Volume))
flatten = FlattenTree(Tree=cull_2, Path="{0}")
remap = RemapNumbers(Value=flatten, Source=bnd, Target=Domain(0, 1))  # -> Mapped, Clipped
flatten_2 = FlattenTree(Tree=cull, Path="{0}")  # disabled
gradient = Gradient(LowerLimit=0, UpperLimit=1, Parameter=remap.Mapped, stops=[0: RGB(0, 128, 0), 0.5: RGB(255, 255, 0), 1: RGB(255, 0, 0)])  # disabled
bar_graph = BarGraph(flatten, BarColor=RGB(255, 0, 90))
mcol = MeshColours(Mesh=graft(flatten_2), Colours=graft(gradient))  # disabled

reread = Button()
# Settings
start_layer_idx = Slider(5, range=0..294)
end_layer_idx = Slider(294, range=0..294)
layer_height = Slider(0.05, range=0..0.1)
point_read_interval = Slider(4, range=1..20)
voxel_size = Slider(0.2, range=0.2..1)

number_slider_3 = Slider(6, range=1..8)
# File Management
panel = Panel("C:\Users\tobyw\SpatterData\Low\")
panel_2 = Panel("G:\My Drive\PHD\Data\IPM\Lattices\MAT\")
series = Series(Start=1, Step=1, Count=Slider(6, range=1..6))
series_2 = Series(Start=1, Step=1, Count=Slider(6, range=1..6))
file_path = FilePath("C:\Users\tobyw\SpatterData\High\")
text = Text(series)
file_path_2 = FilePath(panel)
text_2 = Text(series_2)
concat = Concatenate(FragmentA=file_path, FragmentB=text)
concat_2 = Concatenate(FragmentA=file_path_2, FragmentB=text_2)
merge = Merge(Data1=concat_2, Data2=concat)
list_files = ListFiles(Folder=concat, SearchMask="*.csv", recursive=True)
shift = ShiftPaths(Data=list_files, Offset=Slider(1, range=-2..2))
text_split = TextSplit(Text=shift, Separators="_")
list_item = ListItem(List=text_split, Index="1", Wrap=True)
pshift = ShiftPaths(Data=list_item, Offset=-1)
dom = ConstructDomain(DomainStart=start_layer_idx, DomainEnd=end_layer_idx)
sort_list = SortList(Keys=pshift, ValuesValuesA=shift)  # -> Keys, ValuesValuesA
multiplication = Multiplication(A=sort_list.Keys, B=layer_height)
subset = SubList(List=multiplication, Domain=dom, Wrap=False)  # -> List, Index
subset_2 = SubList(List=sort_list.ValuesValuesA, Domain=dom, Wrap=False)  # -> List, Index

panel_3 = Panel("""\\wsl.localhost\Ubuntu\home\toby_wilkinson\projects\IPMML\training\high_spatter\std\high_std_voxels1.csv
\\wsl.localhost\Ubuntu\home\toby_wilkinson\projects\IPMML\training\high_spatter\std\high_std_voxels2.csv""")

pshift_2 = ShiftPaths(Data=subset.List, Offset=-1)
pshift_3 = ShiftPaths(Data=subset_2.List, Offset=-1)
voxelisedata = VoxeliseData(
    Input=pshift_3,
    XColumnName="GalvoXActualCartesian",
    YColumnName="GalvoYActualCartesian",
    DataColumnName="Photodiode1Normalised",
    LayerHeights=pshift_2,
    PointReadInterval=point_read_interval,
    VoxelSize=voxel_size,
    Method=1,
    ExtractionRadius=1,
    Reset=reread)

voxelisedata_2 = VoxeliseData(
    Input=subset_2.List,
    XColumnName="GalvoXActualCartesian",
    YColumnName="GalvoYActualCartesian",
    DataColumnName="Photodiode1Normalised",
    LayerHeights=subset.List,
    PointReadInterval=point_read_interval,
    VoxelSize=voxel_size,
    Method=1,
    ExtractionRadius=1,
    Reset=reread)  # disabled
log = CSharpScript()  # -> out, a
# ---------- log: C# ----------
// Grasshopper Script Instance
#region Usings
using System;
using System.Linq;
using System.Collections;
using System.Collections.Generic;
using System.Drawing;

using Rhino;
using Rhino.Geometry;

using Grasshopper;
using Grasshopper.Kernel;
using Grasshopper.Kernel.Data;
using Grasshopper.Kernel.Types;
#endregion

public class Script_Instance : GH_ScriptInstance
{
    #region Notes
    /* 
      Members:
        RhinoDoc RhinoDocument
        GH_Document GrasshopperDocument
        IGH_Component Component
        int Iteration

      Methods (Virtual & overridable):
        Print(string text)
        Print(string format, params object[] args)
        Reflect(object obj)
        Reflect(object obj, string method_name)
    */
    #endregion

    static double Threshold;
    static Func<double, double> DelegateFunction;

    private void RunScript(ref object a)
    {
        a = new Func<double, double>(Exponent);
    }

    static double Exponent(double v)
    {
        return Math.Log(v);
    }
}
# ---------- end log ----------
dom_2 = ConstructDomain(DomainStart=Slider(300, range=0..302), DomainEnd=Slider(400, range=0..502))

number_slider_4 = Slider(0.5, range=0..1)  # disabled
columnnormalisation = ColumnNormalisation(VoxelData=voxelisedata_2)  # disabled
spatialcorrelation = SpatialCorrelation(VoxelData=columnnormalisation, VoxelRadius=1)  # disabled
weightedsumdelegate = WeightedSumDelegate(Weight=number_slider_4)  # -> out, F; inputs Weight: Double; disabled
# ---------- weightedsumdelegate: C# ----------
// Grasshopper Script Instance
#region Usings
using System;
using System.Linq;
using System.Collections;
using System.Collections.Generic;
using System.Drawing;

using Rhino;
using Rhino.Geometry;

using Grasshopper;
using Grasshopper.Kernel;
using Grasshopper.Kernel.Data;
using Grasshopper.Kernel.Types;
#endregion

public class Script_Instance : GH_ScriptInstance
{
    #region Notes
    /* 
      Members:
        RhinoDoc RhinoDocument
        GH_Document GrasshopperDocument
        IGH_Component Component
        int Iteration

      Methods (Virtual & overridable):
        Print(string text)
        Print(string format, params object[] args)
        Reflect(object obj)
        Reflect(object obj, string method_name)
    */
    #endregion

    public static double _weight;
    public static Func<double, double, double> _func;

    private void RunScript(double Weight, ref object F)
    {
        // Write your logic here

        _weight = Weight;
        _func = WeightedSum;

        F = _func;
    }

    static public double WeightedSum(double a, double b)
    {
        return -_weight * a + (1 - _weight) * b;
    }
}
# ---------- end weightedsumdelegate ----------
customfunction = RunCustomFunctionTwo(VoxelData1=spatialcorrelation, Function=weightedsumdelegate.F)  # disabled

clampvoxelvalues = ClampVoxelValues(VoxelData=voxelisedata, Range=dom_2)
c_script = CSharpScript(p=Slider(1.96, range=-24..24))  # -> out, a; inputs p: Double
# ---------- c_script: C# ----------
// Grasshopper Script Instance
#region Usings
using System;
using System.Linq;
using System.Collections;
using System.Collections.Generic;
using System.Drawing;

using Rhino;
using Rhino.Geometry;

using Grasshopper;
using Grasshopper.Kernel;
using Grasshopper.Kernel.Data;
using Grasshopper.Kernel.Types;
#endregion

public class Script_Instance : GH_ScriptInstance
{
    #region Notes
    /* 
      Members:
        RhinoDoc RhinoDocument
        GH_Document GrasshopperDocument
        IGH_Component Component
        int Iteration

      Methods (Virtual & overridable):
        Print(string text)
        Print(string format, params object[] args)
        Reflect(object obj)
        Reflect(object obj, string method_name)
    */
    #endregion

    static double Threshold;
    static Func<double, double> DelegateFunction;

    private void RunScript(double p, ref object a)
    {
        Threshold = p;

        a = new Func<double, double>(ThresholdGreater);
    }

    static double ThresholdGreater(double v)
    {
        return v > Threshold ? 1 : 0;
    }
}
# ---------- end c_script ----------
c_script_2 = CSharpScript(MinParam=Slider(0.2, range=0..0.7), MaxParam=Slider(0, range=0..0.3))  # -> out, Mapped; inputs Values: tree of Double, MinParam: Double, MaxParam: Double; disabled
# ---------- c_script_2: C# ----------
// Grasshopper Script Instance
#region Usings
using System;
using System.Linq;
using System.Collections;
using System.Collections.Generic;
using System.Drawing;

using Rhino;
using Rhino.Geometry;

using Grasshopper;
using Grasshopper.Kernel;
using Grasshopper.Kernel.Data;
using Grasshopper.Kernel.Types;
#endregion

public class Script_Instance : GH_ScriptInstance
{
    #region Notes
    /* 
      Members:
        RhinoDoc RhinoDocument
        GH_Document GrasshopperDocument
        IGH_Component Component
        int Iteration

      Methods (Virtual & overridable):
        Print(string text)
        Print(string format, params object[] args)
        Reflect(object obj)
        Reflect(object obj, string method_name)
    */
    #endregion

    private void RunScript(
	DataTree<double> Values,
	double MinParam,
	double MaxParam,
	ref object Mapped)
    {
        DataTree<double> outValues = new DataTree<double>();

        double dataMin = double.MaxValue;
        double dataMax = double.MinValue;

        foreach (var path in Values.Paths)
        {
            outValues.EnsurePath(path);
            var pathItems = Values.Branch(path);
            foreach (var value in pathItems)
            {
                if (value < dataMin) dataMin = value;
                if (value > dataMax) dataMax = value;
            }
        }

        foreach (var path in Values.Paths)
        {
            outValues.EnsurePath(path);
            var pathItems = Values.Branch(path);
            double[] outItems = new double[pathItems.Count];

            for (int i = 0; i < pathItems.Count; i++)
            {
                double value = pathItems[i];
                outItems[i] = Math.Max(Math.Min(Remap(value, dataMin, dataMax), MinParam), MaxParam);
            }
            outValues.AddRange(outItems, path);
        }
        Mapped = outValues;
    }

    private static double Remap(double x, double min, double max)
    {
        return (x - min) / (max - min);
    }
}
# ---------- end c_script_2 ----------
maxminnormalisevoxels = MaxMinNormaliseVoxels(VoxelData=clampvoxelvalues, Range=dom_2)
dom_3 = ConstructDomain(DomainStart=Slider(0.008, range=0..0.01084), DomainEnd=Slider(0.01084, range=0..0.01084))
explodevoxels = ExplodeVoxels(VoxelData=voxelisedata)  # -> VoxelCentres, VoxelIndices, VoxelValues
domcen = CenteredDomain(DomainSize=Slider(2, range=0..10))
number_slider_5 = Slider(1, range=0..1)
bounds = Bounds(Numbers=flatten(explodevoxels.VoxelValues))
remap_2 = RemapNumbers(Value=explodevoxels.VoxelValues, Source=bounds, Target=Domain(0, 1))  # -> Mapped, Clipped; disabled
pdecon = Deconstruct(Point=graft(explodevoxels.VoxelIndices))  # -> XComponent, YComponent, ZComponent; disabled
construct_domain = ConstructDomain(DomainStart=Slider(0.65, range=0..1), DomainEnd=Slider(1, range=0..1))
voxelpreview = VoxelPreview(VoxelData=maxminnormalisevoxels, ScalarRange=bounds, PointWeight=5)  # disabled
bar_graph_2 = BarGraph(explodevoxels.VoxelValues, BarColor=RGB(255, 0, 90))
merge_2 = Merge(Data1=pdecon.XComponent, Data2=pdecon.YComponent, Data3=pdecon.ZComponent, Data4=graft(remap_2.Mapped))  # disabled
join = TextJoin(Text=merge_2, Join=",")  # disabled
trim = TrimTree(Tree=join, Depth=1)
panel_4 = Panel("""C:\Users\tobyw\low_std_gi_voxels1.csv
C:\Users\tobyw\low_std_gi_voxels2.csv
C:\Users\tobyw\low_std_gi_voxels3.csv
C:\Users\tobyw\low_std_gi_voxels4.csv
C:\Users\tobyw\low_std_gi_voxels5.csv
C:\Users\tobyw\low_std_gi_voxels6.csv
C:\Users\tobyw\high_std_gi_voxels1.csv
C:\Users\tobyw\high_std_gi_voxels2.csv
C:\Users\tobyw\high_std_gi_voxels3.csv
C:\Users\tobyw\high_std_gi_voxels4.csv
C:\Users\tobyw\high_std_gi_voxels5.csv
C:\Users\tobyw\high_std_gi_voxels6.csv""")
panel_5 = Panel("""C:\Users\tobyw\low_mean_voxels1.csv
C:\Users\tobyw\low_mean_voxels2.csv
C:\Users\tobyw\low_mean_voxels3.csv
C:\Users\tobyw\low_mean_voxels4.csv
C:\Users\tobyw\low_mean_voxels5.csv
C:\Users\tobyw\low_mean_voxels6.csv
C:\Users\tobyw\high_mean_voxels1.csv
C:\Users\tobyw\high_mean_voxels2.csv
C:\Users\tobyw\high_mean_voxels3.csv
C:\Users\tobyw\high_mean_voxels4.csv
C:\Users\tobyw\high_mean_voxels5.csv
C:\Users\tobyw\high_mean_voxels6.csv""")
panel_6 = Panel("""C:\Users\tobyw\high_std_voxels1.csv
C:\Users\tobyw\high_std_voxels2.csv
C:\Users\tobyw\high_std_voxels3.csv
C:\Users\tobyw\high_std_voxels4.csv
C:\Users\tobyw\high_std_voxels5.csv
C:\Users\tobyw\high_std_voxels6.csv""")
ins = InsertItems(List=trim, Item="x,y,z,value", Indices=0, Wrap=True)
shift_2 = ShiftPaths(Data=ins, Offset=-1)
panel_7 = Panel("""C:\Users\tobyw\low_std_bottom_voxels1.csv
C:\Users\tobyw\low_std_bottom_voxels2.csv
C:\Users\tobyw\low_std_bottom_voxels3.csv
C:\Users\tobyw\low_std_bottom_voxels4.csv
C:\Users\tobyw\low_std_bottom_voxels5.csv
C:\Users\tobyw\low_std_bottom_voxels6.csv
C:\Users\tobyw\high_std_bottom_voxels1.csv
C:\Users\tobyw\high_std_bottom_voxels2.csv
C:\Users\tobyw\high_std_bottom_voxels3.csv
C:\Users\tobyw\high_std_bottom_voxels4.csv
C:\Users\tobyw\high_std_bottom_voxels5.csv
C:\Users\tobyw\high_std_bottom_voxels6.csv""")
path = FilePath(graft(panel_6))
panel_8 = Panel("""C:\Users\tobyw\low_std_top_voxels1.csv
C:\Users\tobyw\low_std_top_voxels2.csv
C:\Users\tobyw\low_std_top_voxels3.csv
C:\Users\tobyw\low_std_top_voxels4.csv
C:\Users\tobyw\low_std_top_voxels5.csv
C:\Users\tobyw\low_std_top_voxels6.csv
C:\Users\tobyw\high_std_top_voxels1.csv
C:\Users\tobyw\high_std_top_voxels2.csv
C:\Users\tobyw\high_std_top_voxels3.csv
C:\Users\tobyw\high_std_top_voxels4.csv
C:\Users\tobyw\high_std_top_voxels5.csv
C:\Users\tobyw\high_std_top_voxels6.csv""")
writetxt = WriteToTextFile(Run=Button(), TextToWrite=shift_2, FilePath=path, Append=False, NewOnly=True)
panel_9 = Panel(writetxt)

# ----
# \\wsl.localhost\Ubuntu\home\toby_wilkinson\projects\IPMML\training\Pores\High\high_pores1.csv
# \\wsl.localhost\Ubuntu\home\toby_wilkinson\projects\IPMML\training\Pores\High\high_pores2.csv
# \\wsl.localhost\Ubuntu\home\toby_wilkinson\projects\IPMML\training\Pores\High\high_pores3.csv
# \\wsl.localhost\Ubuntu\home\toby_wilkinson\projects\IPMML\training\Pores\High\high_pores4.csv
# \\wsl.localhost\Ubuntu\home\toby_wilkinson\projects\IPMML\training\Pores\High\high_pores5.csv
# \\wsl.localhost\Ubuntu\home\toby_wilkinson\projects\IPMML\training\Pores\High\high_pores6.csv
panel_10 = Panel("""\\wsl.localhost\Ubuntu\home\toby_wilkinson\projects\IPMML\volume1.csv
\\wsl.localhost\Ubuntu\home\toby_wilkinson\projects\IPMML\volume2.csv
\\wsl.localhost\Ubuntu\home\toby_wilkinson\projects\IPMML\volume3.csv
\\wsl.localhost\Ubuntu\home\toby_wilkinson\projects\IPMML\volume4.csv
\\wsl.localhost\Ubuntu\home\toby_wilkinson\projects\IPMML\volume5.csv
\\wsl.localhost\Ubuntu\home\toby_wilkinson\projects\IPMML\volume6.csv""")
readvoxelsfromcsv = ReadVoxelsFromCSV(Filepath=graft(panel_10), VoxelSize=voxel_size)
spatialcorrelation_2 = SpatialCorrelation(VoxelData=readvoxelsfromcsv, VoxelRadius=1)  # disabled
explodevoxels_2 = ExplodeVoxels(VoxelData=readvoxelsfromcsv)  # -> VoxelCentres, VoxelIndices, flatten(VoxelValues)
vector_xyz = VectorXYZ(XComponent=Slider(14, range=0..100), YComponent=0, ZComponent=0)  # -> Vector, Length
bnd_2 = Bounds(Numbers=flatten(explodevoxels_2.VoxelValues))
move = Move(Geometry=readvoxelsfromcsv, Motion=vector_xyz.Vector)  # -> Geometry, Transform
dom_4 = ConstructDomain(DomainStart=Slider(0, range=-3.6..45.6), DomainEnd=Slider(5, range=-3.6..45.6))
dom_5 = ConstructDomain(DomainStart=Slider(0.65, range=0..1), DomainEnd=Slider(1, range=0..1))
filtervoxels = FilterVoxels(VoxelData=move.Geometry, ScalarRange=dom_5, RemoveZeros=False, Normalise=False)
number_slider_6 = Slider(5, range=5..10)
dom_6 = ConstructDomain(DomainStart=Slider(0, range=0..0.014), DomainEnd=Slider(0.008, range=0..0.014))
bar_graph_3 = BarGraph(explodevoxels_2.VoxelValues, BarColor=RGB(255, 0, 90))
voxelpreview_2 = VoxelPreview(VoxelData=filtervoxels, ScalarRange=bnd_2, PointWeight=number_slider_6, ColourbarTitle="Spatial Corr.")

voxelisepores = VoxelisePores(PoreMeshes=disjoint, VoxelData=voxelisedata, KClosestPoints=Slider(10, range=1..20))
dom_7 = ConstructDomain(DomainStart=Slider(-1, range=-1..0), DomainEnd=Slider(1, range=0..1))
construct_domain_2 = ConstructDomain(DomainStart=Slider(0, range=0..1), DomainEnd=Slider(1, range=0..1))
vector_xyz_2 = VectorXYZ(XComponent=Slider(0, range=0..25), YComponent=0, ZComponent=0)  # -> Vector, Length

log_2 = RunCustomFunctionOne(VoxelData=voxelisepores, Function=log.a)

explodevoxels_3 = ExplodeVoxels(VoxelData=log_2)  # -> VoxelCentres, VoxelIndices, VoxelValues
bnd_3 = Bounds(Numbers=flatten(explodevoxels_3.VoxelValues))
remapvoxels = RemapVoxels(VoxelData=log_2, InputRange=bnd_3, RemapRange=dom_7)
sigmoid = Sigmoid(VoxelData=remapvoxels, Slope=Slider(2, range=0..15))
filtervoxels_2 = FilterVoxels(VoxelData=sigmoid, ScalarRange=construct_domain, RemoveZeros=False, Normalise=False)
move_2 = Move(Geometry=sigmoid, Motion=vector_xyz_2.Vector)  # -> Geometry, Transform
voxelpreview_3 = VoxelPreview(VoxelData=filtervoxels_2, ScalarRange=construct_domain_2, PointWeight=number_slider_6, ColourbarTitle="Porosity")

clampvoxelvalues_2 = ClampVoxelValues(VoxelData=remapvoxels, Range=domcen)  # disabled

explodevoxels_4 = ExplodeVoxels(VoxelData=sigmoid)  # -> VoxelCentres, VoxelIndices, VoxelValues
pdecon_2 = Deconstruct(Point=graft(explodevoxels_4.VoxelIndices))  # -> XComponent, YComponent, ZComponent; disabled
bar_graph_4 = BarGraph(explodevoxels_4.VoxelValues, BarColor=RGB(255, 0, 90))
merge_3 = Merge(
    Data1=pdecon_2.XComponent,
    Data2=pdecon_2.YComponent,
    Data3=pdecon_2.ZComponent,
    Data4=graft(explodevoxels_4.VoxelValues))  # disabled
join_2 = TextJoin(Text=merge_3, Join=",")
trim_2 = TrimTree(Tree=join_2, Depth=1)
ins_2 = InsertItems(List=trim_2, Item="x,y,z,value", Indices=0, Wrap=True)
panel_11 = Panel("""C:\Users\tobyw\high_pores1.csv
C:\Users\tobyw\high_pores2.csv
C:\Users\tobyw\high_pores3.csv
C:\Users\tobyw\high_pores4.csv
C:\Users\tobyw\high_pores5.csv
C:\Users\tobyw\high_pores6.csv""")
export = Button()
shift_3 = ShiftPaths(Data=ins_2, Offset=-1)
path_2 = FilePath(graft(panel_11))
writetxt_2 = WriteToTextFile(Run=export, TextToWrite=shift_3, FilePath=path_2, Append=False, NewOnly=False)
panel_12 = Panel(writetxt_2)

columnnormalisation_2 = ColumnNormalisation(VoxelData=voxelisedata)  # disabled
explodevoxels_5 = ExplodeVoxels(VoxelData=columnnormalisation_2)  # -> VoxelCentres, VoxelIndices, VoxelValues
stats = Statistics(Series=flatten(explodevoxels_5.VoxelValues))  # -> SampleMean, Median, Average, StandardDeviation, Skewness, Kurtosis, Variance
spatialcorrelation_3 = SpatialCorrelation(VoxelData=columnnormalisation_2, VoxelRadius=1, GlobalMean=stats.SampleMean, GlobalSTD=stats.StandardDeviation)
dom_8 = ConstructDomain(DomainStart=Slider(0.5, range=-19..24), DomainEnd=Slider(1.1, range=-11..24))
explodevoxels_6 = ExplodeVoxels(VoxelData=voxelisedata)  # -> VoxelCentres, VoxelIndices, VoxelValues
bar_graph_5 = BarGraph(explodevoxels_6.VoxelValues, BarColor=RGB(255, 0, 90))
bounds_2 = Bounds(Numbers=flatten(explodevoxels_6.VoxelValues))
voxelpreview_4 = VoxelPreview(VoxelData=voxelisedata, ScalarRange=bounds_2, PointWeight=5)  # disabled

nickname = RunCustomFunctionOne(VoxelData=spatialcorrelation_3, Function=c_script.a)

filtervoxels_3 = FilterVoxels(VoxelData=nickname, ScalarRange=dom_8, RemoveZeros=False, Normalise=False)

correlationcoefficients = CorrelationCoefficients(VoxelData1=spatialcorrelation_3, VoxelData2=voxelisepores)  # -> PearsonCoefficient, PearsonP, SpearmanRankCoefficient, SpearmanP
panel_13 = Panel(correlationcoefficients.SpearmanRankCoefficient)
